# Grasshopper definition Project2GrasshopperSim.gh (Grasshopper 0.9.76)

# ---- group: grid
slider = Slider(18, range=0..25)
sqgrid = Square(Plane=PlaneXY(0, 0, 0), Size=1, ExtentX=slider, ExtentY=slider)  # -> Cells, flatten(Points)

# ----
expression = Expression(p=sqgrid.Points, Expression="p.x")
expression_2 = Expression(p=sqgrid.Points, Expression="p.y")
pt = Point(sqgrid.Points)
lng = ListLength(List=pt)
panel = Panel(expression)
panel_2 = Panel(expression_2)
random = Random(Range="(0,2.999999)", Number=lng, Seed=Slider(3.3, range=0..5))
iterations = Slider(11, range=0..50)
expression_3 = Expression(x=random, Expression="int(x)")
random_2 = Random(Range="(0,1.999999)", Number=lng, Seed=Slider(3.3, range=0..5))
panel_3 = Panel(expression_3)
expression_4 = Expression(x=random_2, Expression="int(x)")
panel_4 = Panel(expression_4)
c_script = CSharpScript(
    Xpositions=expression,
    Ypositions=expression_2,
    Plant_states=expression_4,
    Plant_type=expression_3,
    Iterations=iterations)  # -> Out, Width_radius, Height, Plant_states_out, Color

# ----
# Red Yucca
swatch = ColourSwatch(SwatchColor=RGB(125, 143, 77))
panel_5 = Panel([ColourSwatch(SwatchColor=RGB(125, 143, 77)), ColourSwatch(SwatchColor=RGB(194, 78, 118)), swatch])
item = ListItem(List=panel_5, Index=c_script.Color, Wrap=True)

# ----
# Little Bluestem
swatch_2 = ColourSwatch(SwatchColor=RGB(194, 2, 34))
panel_6 = Panel([ColourSwatch(SwatchColor=RGB(144, 165, 166)), swatch_2, ColourSwatch(SwatchColor=RGB(135, 88, 68))])
item_2 = ListItem(List=panel_6, Index=c_script.Color, Wrap=True)

# ----
# Bear Grass
swatch_3 = ColourSwatch(SwatchColor=RGB(144, 163, 65))
panel_7 = Panel([swatch_3, ColourSwatch(SwatchColor=RGB(187, 191, 168)), ColourSwatch(SwatchColor=RGB(144, 163, 65))])
item_3 = ListItem(List=panel_7, Index=c_script.Color, Wrap=True)

expression_5 = Expression(p=pt, y=c_script.Height, Expression="p.z+y")
cir = Circle(Plane=pt, Radius=c_script.Width_radius)
viewer = ParamViewer(expression_3)
vec2pt = Vector2Pt(PointA=pt, PointB=expression_5, Unitize=False)  # -> Vector, Length
path = ConstructPath()
expression_6 = Expression(x=[item_2, item, item_3], y=lng, z=expression_3)
boundary = BoundarySurfaces(Edges=cir)
extr = Extrude(Base=boundary)
preview = CustomPreview(Shader={ambient=RGB(0, 0, 0), diffuse=RGB(255, 105, 180), emission=RGB(76, 32, 54), shine=0.5, specular=RGB(255, 255, 255), transparency=0})
